# Grasshopper definition M6U1&U2_Group Assignment.gh (Grasshopper 1.0.8)

setback = Slider(3, range=2.4..10)
default_plot_200x200 = Rectangle(Plane=PlaneXY(0, 0, 0), XSize=Domain(0, 200), YSize=Domain(0, 200), Radius=0)  # -> Rectangle, Length
floor_height = Slider(4, range=3..5)
num_floors = Slider(10, range=5..50)
inward_offset = Negative(Value=setback)
plot_boundary = Curve(default_plot_200x200.Rectangle)
floor_elevations = Series(Start=0, Step=floor_height, Count=num_floors)
total_height = Multiplication(A=num_floors, B=floor_height)
footprint_offset = OffsetCurve(Curve=plot_boundary, Distance=inward_offset, Corners=1)
plot_area = Area(Geometry=plot_boundary)  # -> Area, Centroid
col_spacing = Slider(6, range=4..10)
length = Length(Curve=footprint_offset)
unit_z = UnitZ(Factor=floor_elevations)
spacing_calc = Division(A=length, B=col_spacing)
footprint_area = Area(Geometry=footprint_offset)  # -> Area, Centroid
top_vector = UnitZ(Factor=total_height)
column_base_points = DivideCurve(Curve=footprint_offset, Count=spacing_calc, Kinks=False)  # -> Points, Tangents, Parameters
move_to_floors = Move(Geometry=footprint_offset, Motion=unit_z)  # -> Geometry, Transform
_60_plot_area = Multiplication(A=plot_area.Area, B=0.6)
floor_plates = BoundarySurfaces(Edges=flatten(move_to_floors.Geometry))
area_check = SmallerThan(FirstNumber=footprint_area.Area, SecondNumber=_60_plot_area)  # -> SmallerThan, OrEqualTo
concrete_swatch = ColourSwatch(SwatchColor=RGB(204, 204, 204))
column_top_points = Move(Geometry=column_base_points.Points, Motion=top_vector)  # -> Geometry, Transform
column_lines = Line(StartPoint=column_base_points.Points, EndPoint=column_top_points.Geometry)
steel_swatch = ColourSwatch(SwatchColor=RGB(76, 76, 76))
floor_preview = CustomPreview(Geometry=floor_plates, Material=concrete_swatch)
facade = Loft(
    Curves=flatten(move_to_floors.Geometry),
    Options={Adjust=False, Closed=False, LoftEnds=0, LoftSimp=0, LoftType=0, Rebuild=10, Refit=0.01})
column_preview = CustomPreview(Geometry=column_lines, Material=steel_swatch)
glass_material = CreateMaterial(Diffuse=RGBA(0, 0, 0, 0), Specular=RGB(255, 255, 255), Emission=RGB(0, 0, 0), Transparency=0.7, Shine=0)
indices = Series(Start=1, Step=1, Count=10)
facade_preview = CustomPreview(Geometry=facade, Material=glass_material)
level_names = Format(Format="L{0:00}", Culture=127, Data0=indices)
